# Grasshopper definition single_family_amber_module7.gh (Grasshopper 1.0.8)

panel = Panel("C:\Users\mintl\Downloads\Building Energy Modeling\single_family_case study\USA_CA_Van.Nuys.AP.722886_TMYx.epw")
importepw = LBImportEPW(epw_file=panel)  # -> location, dry_bulb_temperature, dew_point_temperature, relative_humidity, wind_speed, wind_direction, direct_normal_rad, diffuse_horizontal_rad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; plug-in component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
sunpath = LBSunPath(location=importepw.location, scale="0.5")  # -> report, vectors, altitudes, azimuths, hoys, sun_pts, analemma, daily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; plug-in component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
windrose = LBWindRose(data=importepw.wind_speed, wind_direction=importepw.wind_direction)  # -> report, mesh, compass, orient_line, freq_line, windrose_line, legend, title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; plug-in component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
psychrometricchart = LBPsychrometricChart(
    temperature=importepw.dry_bulb_temperature,
    rel_humidity=importepw.relative_humidity,
    pressure=importepw.barometric_pressure,
    base_pt="-500, -350, 0")  # -> report, title, temp_lines, rh_lines, hr_lines, enth_wb_lines, mesh, legend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; plug-in component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
monthlychart = LBMonthlyChart(data=importepw.dry_bulb_temperature, base_pt="-500, -200, 0")  # -> out, data_mesh, data_lines, col_lines, legend, borders, labels, y_title, title, vis_set; plug-in component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
hourlyplot = LBHourlyPlot(data=importepw.dry_bulb_temperature, base_pt="-500, -80, 0")  # -> report, mesh, legend, borders, labels, title, vis_set; plug-in component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
preview = CustomPreview(
    Geometry=[hourlyplot.legend, hourlyplot.mesh, hourlyplot.labels, hourlyplot.title],
    Material={diffuse=RGB(221, 160, 221), emission=RGB(66, 48, 66), shine=0.5, specular=RGB(255, 255, 255), transparency=0})
utci_polygon = LBUTCIPolygon(psych_chart=psychrometricchart.psych_chart)  # -> report, total_comfort, total_comf_data, polygons, polygon_names, polygon_data; plug-in component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
preview_2 = CustomPreview(
    Geometry=utci_polygon.polygons,
    Material={diffuse=RGB(221, 160, 221), emission=RGB(66, 48, 66), shine=0.5, specular=RGB(255, 255, 255), transparency=0})

genes = GenePool(
    Decimals=0,
    Maximum=35,
    Minimum=25,
    Value=[35, 35, 35, 35, 35, 35, 35, 35, 35, 25, 25, 25, 25, 25, 25, 25, 25, 25, 35, 35, 35, 35, 35, 35])
genes_2 = GenePool(
    Decimals=0,
    Maximum=21,
    Minimum=15,
    Value=[15, 15, 15, 15, 15, 15, 15, 15, 15, 21, 21, 21, 21, 21, 21, 21, 21, 21, 15, 15, 15, 15, 15, 15])
genes_3 = GenePool(
    Decimals=0,
    Maximum=35.001,
    Minimum=35,
    Value=[35.00022, 35.00022, 35.00023, 35.0005, 35.0005, 35.0005, 35.0005, 35.0005, 35.0005, 35.0005, 35.0005, 35.0005, 35.0005, 35.0005, 35.0005, 35.0005, 35.0005, 35.0005, 35.0005, 35.0005, 35.0005, 35.0005, 35.0005, 35.0005])
genes_4 = GenePool(
    Decimals=0,
    Maximum=15.001,
    Minimum=15,
    Value=[15.00022, 15.00022, 15.00023, 15.0005, 15.0005, 15.0005, 15.0005, 15.0005, 15.0005, 15.0005, 15.0005, 15.0005, 15.0005, 15.0005, 15.0005, 15.0005, 15.0005, 15.0005, 15.0005, 15.0005, 15.0005, 15.0005, 15.0005, 15.0005])
typelimit = HBTypeLimit(name="heating", low_limit="0", up_limit="100", unit_type="Temperature")  # -> report, type_limit; plug-in component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
typelimit_2 = HBTypeLimit(name="cooling", low_limit="0", up_limit="100", unit_type="Temperature")  # -> report, type_limit; plug-in component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
weeklyschedule = HBWeeklySchedule(
    sun=genes_4,
    mon=genes_2,
    tue=genes_2,
    wed=genes_2,
    thu=genes_2,
    fri=genes_2,
    sat=genes_4,
    type_limit=typelimit.type_limit)  # -> report, schedule, idf_year, idf_week, idf_days; plug-in component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
weeklyschedule_2 = HBWeeklySchedule(sun=genes_3, mon=genes, tue=genes, wed=genes, thu=genes, fri=genes, sat=genes_3, type_limit=typelimit_2.type_limit)  # -> report, schedule, idf_year, idf_week, idf_days; plug-in component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
setpoint = HBSetpoint(heating_sch=weeklyschedule.schedule, cooling_sch=weeklyschedule_2.schedule)  # -> setpoint; plug-in component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

# ----
# https://climate.onebuilding.org/WMO_Region_4_North_and_Central_America/USA_United_States_of_America/CA_California/USA_CA_Van.Nuys.AP.722886_TMYx.zip
button = Button()
epwmap = LBEPWmap(epw_map=button)  # -> report; plug-in component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
bldgvintages = HBBuildingVintages({"ASHRAE 90.1 2019  |  IECC 2021": "2019", "ASHRAE 90.1 2016  |  IECC 2018": "2016", "ASHRAE 90.1 2013  |  IECC 2015": "2013", "ASHRAE 90.1 2010  |  IECC 2012": "2010", "ASHRAE 90.1 2007  |  IECC 2009": "2007", "ASHRAE 90.1 2004  |  IECC 2006": "2004", "1980-2004 (CBECS)": "1980_2004", "Pre-1980 (CBECS)": "pre_1980"}, selected="ASHRAE 90.1 2019  |  IECC 2021")
bldgprograms = HBBuildingPrograms({"LargeOffice", "MediumOffice", "SmallOffice", "MidriseApartment", "HighriseApartment", "Retail", "StripMall", "PrimarySchool", "SecondarySchool", "SmallHotel", "LargeHotel", "Hospital", "Outpatient", "Laboratory", "Warehouse", "SuperMarket", "FullServiceRestaurant", "QuickServiceRestaurant", "Courthouse", "College", "LargeDataCenterHighITE", "LargeDataCenterLowITE", "SmallDataCenterHighITE", "SmallDataCenterLowITE"}, selected="MidriseApartment")
constructiontypes = HBConstructionTypes({"SteelFramed", "WoodFramed", "Mass", "Metal Building"}, selected="WoodFramed")
climatezones = HBClimateZones({"1 - Very Hot": "1", "2 - Hot": "2", "3 - Warm": "3", "4 - Mixed": "4", "5 - Cool": "5", "6 - Cold": "6", "7 - Very Cold": "7", "8 - Subarctic": "8"}, selected="3 - Warm")
constrsetclimate = HBConstructionSetByClimate(climate_zone=climatezones, vintage=bldgvintages, constr_type=constructiontypes)  # -> constr_set; plug-in component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
searchprog = HBSearchPrograms(bldg_prog=bldgprograms)  # -> room_prog; plug-in component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
item = ListItem(List=searchprog, Index=0, Wrap=True)
panel_2 = Panel(constrsetclimate)
panel_3 = Panel(item)

bldgvintages_2 = HBBuildingVintages({"ASHRAE 90.1 2019  |  IECC 2021": "2019", "ASHRAE 90.1 2016  |  IECC 2018": "2016", "ASHRAE 90.1 2013  |  IECC 2015": "2013", "ASHRAE 90.1 2010  |  IECC 2012": "2010", "ASHRAE 90.1 2007  |  IECC 2009": "2007", "ASHRAE 90.1 2004  |  IECC 2006": "2004", "1980-2004 (CBECS)": "1980_2004", "Pre-1980 (CBECS)": "pre_1980"}, selected="ASHRAE 90.1 2019  |  IECC 2021")
constructiontypes_2 = HBConstructionTypes({"SteelFramed", "WoodFramed", "Mass", "Metal Building"}, selected="WoodFramed")
climatezones_2 = HBClimateZones({"1 - Very Hot": "1", "2 - Hot": "2", "3 - Warm": "3", "4 - Mixed": "4", "5 - Cool": "5", "6 - Cold": "6", "7 - Very Cold": "7", "8 - Subarctic": "8"}, selected="3 - Warm")
constrsetclimate_2 = HBConstructionSetByClimate(climate_zone=climatezones_2, vintage=bldgvintages_2, constr_type=constructiontypes_2)  # -> constr_set; plug-in component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
panel_4 = Panel(constrsetclimate_2)

bldgprograms_2 = HBBuildingPrograms({"LargeOffice", "MediumOffice", "SmallOffice", "MidriseApartment", "HighriseApartment", "Retail", "StripMall", "PrimarySchool", "SecondarySchool", "SmallHotel", "LargeHotel", "Hospital", "Outpatient", "Laboratory", "Warehouse", "SuperMarket", "FullServiceRestaurant", "QuickServiceRestaurant", "Courthouse", "College", "LargeDataCenterHighITE", "LargeDataCenterLowITE", "SmallDataCenterHighITE", "SmallDataCenterLowITE"}, selected="Warehouse")
searchprog_2 = HBSearchPrograms(bldg_prog=bldgprograms_2)  # -> room_prog; plug-in component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
item_2 = ListItem(List=searchprog_2, Index=Slider(1, range=0..2), Wrap=True)
panel_5 = Panel(searchprog_2)
panel_6 = Panel(item_2)

# ---- group: Define Multi-Zones
brep = Brep([<brep referenced from the Rhino model> x2])
intsolid = HBIntersectSolids(rooms=flatten(brep), run=Toggle(True))  # -> int_rooms; plug-in component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
item_3 = ListItem(List=intsolid, Index="1", Wrap=True)
item_4 = ListItem(List=intsolid, Index="0", Wrap=True)

# ---- group: House
panel_7 = Panel("2019::MidriseApartment::Apartment")
programtype = HBProgramType(base_program=panel_7, setpoint=setpoint)  # -> program; plug-in component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
applyloadvals = HBApplyLoadValues(room_or_program=flatten(panel_7), infilt_per_exterior="0.0003")  # -> report, mod_obj; plug-in component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
panel_8 = Panel(applyloadvals.mod_obj)
roomsolid = HBRoomFromSolid(
    geo=flatten(item_4),
    name="house",
    constr_set=constrsetclimate_2,
    program=[applyloadvals.mod_obj, programtype],
    conditioned=True)  # -> report, rooms; plug-in component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

# ---- group: Garage
programtype_2 = HBProgramType(base_program="2019::Warehouse::Fine")  # -> program; plug-in component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
applyloadvals_2 = HBApplyLoadValues(room_or_program=flatten("2019::Warehouse::Fine"))  # -> report, mod_obj; plug-in component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
roomsolid_2 = HBRoomFromSolid(
    geo=flatten(item_3),
    name="garage",
    constr_set=constrsetclimate_2,
    program=[programtype_2, applyloadvals_2.mod_obj],
    conditioned=Toggle(True))  # -> report, rooms; plug-in component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

# ----
panel_9 = Panel("2019::ClimateZone3::WoodFramed")
heating_stpt = Slider(22, range=0..40)
applysetpointvals = HBApplySetpointValues(cooling_setpt=flatten(Slider(28, range=0..40)), heating_setpt=heating_stpt)  # -> report, mod_obj; plug-in component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
idealair = HBIdealAir(rooms=flatten([roomsolid.rooms, roomsolid_2.rooms]))  # -> report, rooms; plug-in component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

doas = HBDOASHVACTemplates({"DOAS with fan coil chiller with boiler": "DOAS_FCU_Chiller_Boiler", "DOAS with fan coil chiller with central air source heat pump": "DOAS_FCU_Chiller_ASHP", "DOAS with fan coil chiller with district hot water": "DOAS_FCU_Chiller_DHW", "DOAS with fan coil chiller with baseboard electric": "DOAS_FCU_Chiller_ElectricBaseboard", "DOAS with fan coil chiller with gas unit heaters": "DOAS_FCU_Chiller_GasHeaters", "DOAS with fan coil chiller with no heat": "DOAS_FCU_Chiller", "DOAS with fan coil air-cooled chiller with boiler": "DOAS_FCU_ACChiller_Boiler", "DOAS with fan coil air-cooled chiller with central air source heat pump": "DOAS_FCU_ACChiller_ASHP", "DOAS with fan coil air-cooled chiller with district hot water": "DOAS_FCU_ACChiller_DHW", "DOAS with fan coil air-cooled chiller with baseboard electric": "DOAS_FCU_ACChiller_ElectricBaseboard"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}, selected="DOAS with water source heat pumps with ground source heat pump": "DOAS_WSHP_GSHP")
heatcool = HBHeatCoolHVACTemplates({"Baseboard electric": "ElectricBaseboard", "Baseboard gas boiler": "BoilerBaseboard", "Baseboard central air source heat pump": "ASHPBaseboard", "Baseboard district hot water": "DHWBaseboard", "Direct evap coolers with baseboard electric": "EvapCoolers_ElectricBaseboard", "Direct evap coolers with baseboard gas boiler": "EvapCoolers_BoilerBaseboard"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}, selected="Window AC with baseboard gas boiler": "WindowAC_BoilerBaseboard")
all_air = HBAllAirHVACTemplates({"VAV chiller with gas boiler reheat": "VAV_Chiller_Boiler", "VAV chiller with central air source heat pump reheat": "VAV_Chiller_ASHP", "VAV chiller with district hot water reheat": "VAV_Chiller_DHW", "VAV chiller with PFP boxes": "VAV_Chiller_PFP", "VAV chiller with gas coil reheat": "VAV_Chiller_GasCoil", "VAV air-cooled chiller with gas boiler reheat": "VAV_ACChiller_Boiler", "VAV air-cooled chiller with central air source heat pump reheat": "VAV_ACChiller_ASHP", "VAV air-cooled chiller with district hot water reheat": "VAV_ACChiller_DHW", "VAV air-cooled chiller with PFP boxes": "VAV_ACChiller_PFP", "VAV air-cooled chiller with gas coil reheat": "VAV_ACChiller_GasCoil"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}, selected="VAV chiller with gas boiler reheat")
shw = HBSHWTemplates({"Gas Water Heater": "Gas_WaterHeater", "Electric Water Heater": "Electric_WaterHeater", "Heat Pump Water Heater": "HeatPump_WaterHeater", "Gas Tankless Heater": "Gas_TanklessHeater", "Electric Tankless Heater": "Electric_TanklessHeater"}, selected="Gas Water Heater")
doashvac = HBDOASHVAC(system_type=doas, dcv=Toggle(False))  # -> report, rooms; plug-in component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
allairhvac = HBAllAirHVAC(system_type=all_air)  # -> report, rooms; plug-in component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
heatcoolhvac = HBHeatCoolHVAC(system_type=heatcool)  # -> report, rooms; plug-in component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
shw_2 = HBSHWSystem(system_type=shw)  # -> report, rooms; plug-in component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

solveadj = HBSolveAdjacency(rooms=flatten(idealair.rooms), adiabatic=Toggle(True), run=Toggle(True))  # -> report, adj_rooms; plug-in component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

geo = Geometry([<extrusion referenced from the Rhino model> x8])
aperture = HBAperture(geo=geo)  # -> report, apertures; plug-in component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
addsubface = HBAddSubface(hb_obj=flatten(solveadj.adj_rooms), sub_faces=flatten(aperture.apertures))  # -> report, hb_obj, unmatched; plug-in component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
geo_2 = Geometry([<brep referenced from the Rhino model> x4])

number_slider = Slider(6, range=1..12)
number_slider_2 = Slider(21, range=1..31)
analysisperiod = LBAnalysisPeriod(start_month=number_slider, start_day=number_slider_2, start_hour=0, end_month=number_slider, end_day=number_slider_2)  # -> period, hoys, dates; plug-in component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
skymatrix = LBCumulativeSkyMatrix(
    location=importepw.location,
    direct_rad=importepw.direct_normal_rad,
    diffuse_rad=importepw.diffuse_horizontal_rad,
    hoys=analysisperiod.hoys)  # -> report, sky_mtx; plug-in component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
radiationdome = LBRadiationDome(sky_mtx=skymatrix.sky_mtx, scale=1)  # -> report, mesh, compass, legend, title, dir_vecs, dir_values, max_pt, max_info, vis_set; plug-in component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
incidentradiation = LBIncidentRadiation(sky_mtx=skymatrix.sky_mtx, geometry=flatten([item_4, geo, geo_2]), grid_size="1", offset_dist="0.1", run=Toggle(True))  # -> report, points, results, total, mesh, legend, title, int_mtx; plug-in component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

# ---- group: Check Multi-Zones
panel_11 = Panel(addsubface.hb_obj)
labelrooms = HBLabelRooms(rooms_model=flatten(addsubface.hb_obj))  # -> label_text, base_pts, labels, wire_frame; plug-in component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

# ----
bordershades = HBExtrudedBorderShades(hb_objs=flatten(addsubface.hb_obj), depth=Slider(0.1, range=0..0.5))  # -> report, hb_objs; plug-in component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
shade = HBShade(geo=geo_2)  # -> report, shades; plug-in component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

# ---- group: 0-house 1-garage
item_5 = ListItem(List=bordershades.hb_objs, Index=Slider(0, range=0..1), Wrap=True)

# ----
panel_12 = Panel(bordershades.hb_objs)
model = HBModel(rooms=flatten(bordershades.hb_objs), shades=flatten(shade.shades))  # -> report, model; plug-in component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

roomenergyattr = HBRoomEnergyAttributes({"Program": "properties.energy.program_type.display_name", "Construction Set": "properties.energy.construction_set.display_name", "Is Conditioned": "properties.energy.is_conditioned", "People per Area [ppl/m2]": "properties.energy.people.people_per_area", "Area per Person [m2/ppl]": "properties.energy.people.area_per_person", "Lighting per Area [W/m2]": "properties.energy.lighting.watts_per_area"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}, selected="Program")
roomattr = HBRoomAttributes({"Display Name": "display_name", "Simulation Name (Identifier)": "identifier", "Multiplier": "multiplier", "Floor Area Excluded": "exclude_floor_area", "Zone": "zone", "Story": "story", "Volume": "volume", "Gross Floor Area": "floor_area", "Exposed Area": "exposed_area", "Exterior Wall Area": "exterior_wall_area", "Exterior Aperture Area": "exterior_aperture_area", "Average Floor Elevation": "average_floor_height"}, selected="Display Name")
legendpar = LBLegendParameters(num_decimals="6")  # -> leg_par; plug-in component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
colorroomattr = HBColorRoomAttributes(rooms_model=flatten(model.model), attribute=roomenergyattr, legend_par=legendpar)  # -> mesh, legend, wire_frame, values, colors, vis_set; plug-in component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

faceenergyattr = HBFaceEnergyAttributes({"Construction": "properties.energy.construction.display_name", "Materials": "properties.energy.construction.layers", "Thickness [m]": "properties.energy.construction.thickness", "Density [kg/m2]": "properties.energy.construction.mass_area_density", "Heat Capacity [J/K-m2]": "properties.energy.construction.area_heat_capacity", "Construction R-Value [m2-K/W]": "properties.energy.construction.r_value", "Construction U-Value [W/m2-K]": "properties.energy.construction.u_value", "Construction U-Factor [W/m2-K]": "properties.energy.construction.u_factor", "Construction SHGC [Unshaded]": "properties.energy.construction.shgc", "R-Factor [m2-K/W]": "properties.energy.r_factor", "U-Factor [W/m2-K]": "properties.energy.u_factor", "SHGC [Unshaded]": "properties.energy.shgc", "Solar Transmitance [Unshaded]": "properties.energy.construction.solar_transmittance", "Visible Transmitance [Unshaded]": "properties.energy.construction.visible_transmittance", "Solar Reflectance [Outside]": "properties.energy.construction.outside_solar_reflectance", "Solar Reflectance [Inside]": "properties.energy.construction.inside_solar_reflectance", "Fraction Area Operable": "properties.energy.vent_opening.fraction_area_operable", "Fraction Height Operable": "properties.energy.vent_opening.fraction_height_operable", "Discharge Coefficient": "properties.energy.vent_opening.discharge_coefficient"}, selected="Materials")
faceattr = HBFaceAttributes({"Display Name": "display_name", "Simulation Name (Identifier)": "identifier", "Boundary Condition": "boundary_condition", "Has Parent": "has_parent", "Parent": "parent", "Azimuth": "azimuth", "Altitude": "altitude", "Area": "area", "Perimeter": "perimeter", "Face Type": "type", "Aperture Is Operable": "is_operable", "Door Is Glass": "is_glass"}, selected="Display Name")
colorfaceattr = HBColorFaceAttributes(hb_objs=flatten(model.model), attribute=faceenergyattr)  # -> mesh, legend, wire_frame, values, colors, vis_set; plug-in component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

panel_13 = Panel("C:\Users\mintl\Downloads\Building Energy Modeling\single_family_case study\USA_CA_Van.Nuys.AP.722886_TMYx.epw")
toggle = BooleanToggle(True)
simoutput = HBSimulationOutput(zone_energy_use=toggle, gains_and_losses=toggle, comfort_metrics=toggle, surface_energy_flow=toggle)  # -> report, sim_output; plug-in component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
toggle_2 = BooleanToggle(False)
simpar = HBSimulationParameter(output=simoutput.sim_output, timestep=6)  # -> sim_par; plug-in component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
modeltoosm = HBModelToOSM(model=model.model, epw_file=panel_13, sim_par=simpar, write=toggle_2, run=toggle_2)  # -> report, jsons, osw, osm, idf, sql, zsz, rdd, html; plug-in component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

panel_14 = Panel(modeltoosm.sql)

panel_15 = Panel("C:\Users\mintl\Downloads\Building Energy Modeling\single_family_case study\USA_CA_Van.Nuys.AP.722886_TMYx.ddy")
toggle_3 = BooleanToggle(True)
neg = Negative(Value="5000")
readhvac = HBReadHVACSizing(sql=modeltoosm.sql)  # -> zone_names, zone_peak_cool, zone_peak_heat, comp_types, comp_properties, comp_values; plug-in component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
readzsz = HBReadZoneSizing(zsz=modeltoosm.zsz)  # -> cooling_load, heating_load; plug-in component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
legendpar_2 = LBLegendParameters(min=neg, max="5000")  # -> leg_par; plug-in component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
peakloads = HBPeakLoads(rooms=item_5, ddy_file=panel_15, run_bal=toggle_3, run=toggle_3)  # -> report, peak_cool, peak_heat, cooling, heating, cool_bal, heat_bal; plug-in component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
toggle_4 = BooleanToggle(True)
toggle_5 = BooleanToggle(True)
toggle_6 = BooleanToggle(True)
monthlychart_2 = LBMonthlyChart(
    data=readzsz.cooling_load,
    base_pt="700, -25, 0",
    x_dim="40",
    stack=toggle_4,
    time_marks=toggle_4,
    legend_par=legendpar_2)  # -> out, data_mesh, data_lines, col_lines, legend, borders, labels, y_title, title, vis_set; plug-in component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
monthlychart_3 = LBMonthlyChart(
    data=readzsz.heating_load,
    base_pt="700, -100, 0",
    x_dim="40",
    stack=toggle_4,
    time_marks=toggle_4,
    legend_par=legendpar_2)  # -> out, data_mesh, data_lines, col_lines, legend, borders, labels, y_title, title, vis_set; plug-in component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
monthlychart_4 = LBMonthlyChart(data=peakloads.heat_bal, base_pt="840, -100, 0", x_dim="40", stack=toggle_6, time_marks=toggle_6, legend_par=legendpar_2)  # -> out, data_mesh, data_lines, col_lines, legend, borders, labels, y_title, title, vis_set; plug-in component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
monthlychart_5 = LBMonthlyChart(data=peakloads.cool_bal, base_pt="840, -25, 0", x_dim="40", stack=toggle_5, time_marks=toggle_5, legend_par=legendpar_2)  # -> out, data_mesh, data_lines, col_lines, legend, borders, labels, y_title, title, vis_set; plug-in component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
peak_cooling = Panel("1952.023963")
peak_heating = Panel("3904.697664")

eui = HBEndUseIntensity(sql=modeltoosm.sql, ip=Toggle(False))  # -> eui, eui_end_use, end_uses, gross_floor; plug-in component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
eui_with_2004_program_and_construction_s = Panel("~206")  # "EUI with 2004 Program and Construction Set"
eui_2 = Panel(eui.eui)
panel_16 = Panel(eui.eui_end_use)
panel_17 = Panel(eui.end_uses)

roomenergyresult = HBReadRoomEnergyResult(sql=modeltoosm.sql)  # -> cooling, heating, lighting, electric_equip, gas_equip, process, hot_water, fan_electric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; plug-in component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
xdata = LBDeconstructData(data=roomenergyresult.people_gain)  # -> header, values; plug-in component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
panel_18 = Panel(xdata.header)
hourlyplot_2 = LBHourlyPlot(
    data=[roomenergyresult.cooling, roomenergyresult.heating, roomenergyresult.solar_gain, roomenergyresult.infiltration_load],
    base_pt="260, -80, 0")  # -> report, mesh, legend, borders, labels, title, vis_set; plug-in component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
preview_3 = CustomPreview(
    Geometry=[hourlyplot_2.mesh, hourlyplot_2.legend, hourlyplot_2.labels, hourlyplot_2.title],
    Material={diffuse=RGB(221, 160, 221), emission=RGB(66, 48, 66), shine=0.5, specular=RGB(255, 255, 255), transparency=0})

faceresult = HBReadFaceResult(sql=modeltoosm.sql)  # -> face_indoor_temp, face_outdoor_temp, face_energy_flow; plug-in component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
roomenergyresult_2 = HBReadRoomEnergyResult(sql=modeltoosm.sql)  # -> cooling, heating, lighting, electric_equip, gas_equip, process, hot_water, fan_electric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; plug-in component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
loadbalance = HBThermalLoadBalance(
    rooms_model=flatten(model.model),
    cooling=roomenergyresult_2.cooling,
    heating=roomenergyresult_2.heating,
    lighting=roomenergyresult_2.lighting,
    electric_equip=roomenergyresult_2.electric_equip,
    hot_water=roomenergyresult_2.hot_water,
    people_gain=roomenergyresult_2.people_gain,
    solar_gain=roomenergyresult_2.solar_gain,
    infiltration_load=roomenergyresult_2.infiltration_load,
    mech_vent_load=roomenergyresult_2.mech_vent_load,
    face_energy_flow=faceresult.face_energy_flow)  # -> report, balance, balance_stor, norm_bal, norm_bal_stor; plug-in component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
colrange = LBColorRange(index="18")  # -> colors; plug-in component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
timeop = LBTimeIntervalOperation(data=[roomenergyresult_2.cooling, roomenergyresult_2.heating])  # -> daily, monthly, mon_per_hr; plug-in component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
legendpar_3 = LBLegendParameters(colors=colrange)  # -> leg_par; plug-in component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
timeop_2 = LBTimeIntervalOperation(data=loadbalance.balance)  # -> daily, monthly, mon_per_hr; plug-in component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
monthlychart_6 = LBMonthlyChart(data=timeop_2.monthly, base_pt="80, -125, 0", stack=Toggle(True), legend_par=legendpar_3)  # -> out, data_mesh, data_lines, col_lines, legend, borders, labels, y_title, title, vis_set; plug-in component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
monthlychart_7 = LBMonthlyChart(data=[importepw.dry_bulb_temperature, timeop.monthly], base_pt="80, -25, 0", stack=Toggle(False))  # -> out, data_mesh, data_lines, col_lines, legend, borders, labels, y_title, title, vis_set; plug-in component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
preview_4 = CustomPreview(
    Geometry=[monthlychart_6.data_mesh, monthlychart_6.data_lines, monthlychart_6.col_lines, monthlychart_6.legend, monthlychart_6.labels, monthlychart_6.y_title, monthlychart_6.title],
    Material={diffuse=RGB(221, 160, 221), emission=RGB(66, 48, 66), shine=0.5, specular=RGB(255, 255, 255), transparency=0})

# ---- group: Multi-Zone EUI Analysis
item_6 = ListItem(List=roomenergyresult_2.cooling, Index=Slider(1, range=0..1), Wrap=True)
timeop_3 = LBTimeIntervalOperation(data=item_6)  # -> daily, monthly, mon_per_hr; plug-in component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
monthlychart_8 = LBMonthlyChart(data=timeop_3.monthly, base_pt="-170,-180")  # -> out, data_mesh, data_lines, col_lines, legend, borders, labels, y_title, title, vis_set; plug-in component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
hourlyplot_3 = LBHourlyPlot(data=item_6, base_pt="-170,-300")  # -> report, mesh, legend, borders, labels, title, vis_set; plug-in component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
colorrooms = HBColorRooms(data=flatten(roomenergyresult_2.cooling), rooms_model=flatten(model.model))  # -> report, mesh, wire_frame, legend, title, rooms, colors, values, vis_set; plug-in component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
preview_5 = CustomPreview(
    Geometry=[hourlyplot_3.legend, hourlyplot_3.labels, hourlyplot_3.title, hourlyplot_3.mesh],
    Material={diffuse=RGB(221, 160, 221), emission=RGB(66, 48, 66), shine=0.5, specular=RGB(255, 255, 255), transparency=0})

# ----
zones = Panel(readhvac.zone_names)
peak_cooling_per_zone = Panel(readhvac.zone_peak_cool)
peak_heating_per_zone = Panel(readhvac.zone_peak_heat)
